# Grasshopper definition SDFDatasetCombinedGen.gh (Grasshopper 1.0.7)

panel = Panel("C:\Users\LabUser\Documents\Sketch-In-Context-Sp2024\SDFDatasets\")
createboxes = GhPythonScript(
    parent_dir=panel,
    num_models="2000",
    num_boxes="1",
    box_min_start="-2",
    box_min_end="0.25",
    box_max_start="-0.25",
    box_max_end="2",
    cube_size="16",
    srf_quads="4300",
    min_verts="4000",
    max_verts="5904",
    srf_pts_delta="0.01",
    num_random_pts="2000",
    run_gen=Toggle(False))  # -> out, models, run_id
# ---------- createboxes: Python ----------
"""Creates Boxes.
    Inputs:
        x: The x script variable
        y: The y script variable
    Output:
        a: The a output variable"""

__author__ = "jlw387"
__version__ = "2022.03.14"

import random
import math
import clr
import System.Drawing as dw
import time
import sys
import os
import csv
import rhinoscriptsyntax as rs
import scriptcontext as sc
import Rhino.Geometry as rg
import Rhino

def gen_coord(start, end):
    return (float(end) - float(start))*random.random() + float(start)

#def populate(model, num, existing):
#    

old_doc = sc.doc
sc.doc = ghdoc

if parent_dir == None or parent_dir == "":
    parent_dir = "C:/Users/jlw387/Documents/Sketching in Context/Spring 2024/SketchToModel/SDFDatasets/"
elif parent_dir[-1] != "/" or parent_dir[-1] != "\\":
    parent_dir += "/"
if num_models == None:
    num_models = 30
if num_boxes == None:
    num_boxes = 3
if box_min_start == None:
    box_min_start = -10
if box_min_end == None:
    box_min_end = 0
if box_max_start == None:
    box_max_start = 0
if box_max_end == None:
    box_max_end = 10
if run_gen == None:
    run_gen = False

tol = 0.00001

qr_params = Rhino.Geometry.QuadRemeshParameters()
qr_params.AdaptiveQuadCount=True
qr_params.TargetQuadCount = int(srf_quads)
qr_params.AdaptiveSize = 50
qr_params.DetectHardEdges=True

min_verts = int(min_verts)
max_verts = int(max_verts)

# start_total = time.time()
if(run_gen):
    views = rs.ViewNames()
    modes=rs.ViewDisplayModes()
    viewtype="Pen"
    rs.EnableRedraw(False)
    if viewtype in modes:
        for view in views:
            rs.ViewDisplayMode(view, viewtype)
            
    current_view = sc.doc.Views.ActiveView.ActiveViewport
    current_view.Size = dw.Size(256,256)
    
    run_id = "Gen_" + str(int(time.time()))
    
    models = []
    boxes = []
    box = []
    world_plane = rg.Plane(rg.Point3d(0,0,0), rg.Vector3d(0,0,1))
    
    os.mkdir(parent_dir + run_id + "/")
    h = 0
    while h < (int(num_models)):
        
        # 
        # Generate Model using Boxes
        #
        boxes = []
        object = []
        # start_t = time.time()
        for i in range(int(num_boxes)):
            temp_box = None
            while(temp_box == None):
                interval_x = rg.Interval(gen_coord(box_min_start, box_min_end), gen_coord(box_max_start, box_max_end))
                interval_y = rg.Interval(gen_coord(box_min_start, box_min_end), gen_coord(box_max_start, box_max_end))
                interval_z = rg.Interval(gen_coord(box_min_start, box_min_end), gen_coord(box_max_start, box_max_end))
                temp_box = rg.Brep.CreateFromBox(rg.Box(world_plane, interval_x, interval_y, interval_z))
            boxes.append(temp_box)
        # print("Box Creation: " + str(time.time() - start_t))
        # start_t = time.time()
        model = rg.Brep.CreateBooleanUnion([boxes[0]], tol)
        for i in range(int(num_boxes) - 1):
            temp_model = []
            if random.randint(0,1):
                for m in model:
                    temp_model.append(m)
                temp_model.append(boxes[i+1])
                model = rg.Brep.CreateBooleanUnion(temp_model, tol)
                # print("Union" + str(i+1))
            else:
                for m in model:
                    temp_res = rg.Brep.CreateBooleanDifference(m, boxes[i+1], tol)
                    for r in temp_res:
                        temp_model.append(r)
                if len(temp_model) > 0:
                    # print("Difference" + str(i+1))
                    model = rg.Brep.CreateBooleanUnion(temp_model, tol)
                # else:
                    # print("Difference" + str(i+1) + " (Failed)")
                    
        if model != None:
            if len(model) == 1:
                rs.MoveObject(model[0], -model[0].GetBoundingBox(True).Center)
                models.append(model[0])
                
                sc.doc = Rhino.RhinoDoc.ActiveDoc
                
                # Add Custom Layer
                if not rs.IsLayer("CustomLayer"):
                    rs.AddLayer("CustomLayer")
                
                # Clear Existing Objects
                rs.DeleteObjects(rs.ObjectsByLayer("CustomLayer"))
                
                # We add both the geometry and the attributes to the Rhino doc
                rhino_brep = sc.doc.Objects.Add(model[0])
                rs.ObjectLayer(rhino_brep, "CustomLayer")
                
                # Create Model Directory and Save Model to Directory
                model_dir = parent_dir + run_id + "/Model_" + str(h) + "/"
                os.mkdir(model_dir)
                # result = rs.Command("_-SaveAs _SaveSmall=_Yes " + chr(34) + model_dir + "Model.3dm" + chr(34), True)
                result = rs.Command("_-SaveAs _SaveSmall=_Yes " + chr(34) + parent_dir + run_id + "\\Model_" + str(h) + "\\Model.3dm" + chr(34), True)
                
                # ==============================================
                # Generate Surface Points Using QuadRemesh
                # ==============================================
                verts = []
                mesh = rg.Mesh.QuadRemeshBrep(model[0], qr_params)
                
                try:
                    verts = mesh.Vertices
                except Exception:
                    pass
                    
                num_attempts = 0
                max_attempts = 10
                min_target_quads = 3700
                max_target_quads = 6000
                current_target_quads = int(srf_quads)
                while num_attempts < max_attempts and (len(verts) < min_verts or len(verts) > max_verts):
                    # Print that this model needed more remeshing to log (so we can double check the result)
                    if num_attempts == 0:
                        print("QRM MULTIPLE ATTEMPTS: " + str(i))
                        
                    # Recompute QuadRemesh TargetQuadCount parameter based on previous QuadRemesh result
                    if mesh is None:
                         current_target_quads += 50
                    elif len(verts) < min_verts:
                        min_target_quads = max(current_target_quads, min_target_quads)
                        current_target_quads = 0.25 * max_target_quads + 0.75 * current_target_quads
                    elif len(verts) > max_verts:
                        max_target_quads = min(current_target_quads, max_target_quads)
                        current_target_quads = 0.5 * min_target_quads + 0.5 * current_target_quads
                    else:
                        break
                        
                    # Set QuadRemesh TargetQuadCount parameter and rerun QuadRemesh attempt
                    qr_params.TargetQuadCount = current_target_quads
                    mesh = rg.Mesh.QuadRemeshBrep(model[0], qr_params)
                    try:
                        verts = mesh.Vertices
                    except Exception:
                        pass
                    num_attempts += 1
                
                # If we achieved an acceptable number of surface vertices, save them to a CSV file.
                if len(verts) >= min_verts and len(verts) <= max_verts:
                    with open(model_dir + "surface_points.csv", "wb") as csvfile:
                        csvwriter = csv.writer(csvfile,  delimiter=',')
                        for v in verts:
                            csvwriter.writerow([v.X, v.Y, v.Z])
                else:
                    # Print that this model failed (so we can rerun manually)
                    print("QRM FAILURE: " + str(i))
                
                # ==============================================
                
                # ==============================================
                # Generate Sketch and Point Samples
                # ==============================================
                
                
                geom = model[0]
                
                phi = math.radians(random.randint(30,150))
                theta = math.radians(random.randint(0,359))
                radius = 40
                
                camLoc = Rhino.Geometry.Point3d(radius*math.sin(phi)*math.cos(theta), radius*math.sin(phi)*math.sin(theta), radius*math.cos(phi))
                        
                rs.ViewCameraTarget(camera=camLoc, target=rg.Point3d(0,0,0))
                bb_object = geom.GetBoundingBox(True)
                rs.ZoomBoundingBox(bb_object)
                
                camLoc, _ = rs.ViewCameraTarget(target=rg.Point3d(0,0,0))
                
                d_hangle = clr.StrongBox[float]()
                v_hangle = clr.StrongBox[float]()
                h_hangle = clr.StrongBox[float]()
                
                current_view.GetCameraAngle(d_hangle, v_hangle, h_hangle)
                horizontal_halfangle = h_hangle.Value
                
                forwards = (rg.Point3d(0,0,0)-camLoc)
                forwards.Unitize()
                
                upwards_fixed = rs.ViewCameraUp()
                
                rightwards = rs.VectorCrossProduct(forwards, upwards_fixed)
                rightwards.Unitize()
                
                upwards = rs.VectorCrossProduct(rightwards, forwards)
                
                viewMatrix = Rhino.Geometry.Transform(1.0)
                
                viewMatrix.M00 = rightwards.X
                viewMatrix.M10 = rightwards.Y
                viewMatrix.M20 = rightwards.Z
                
                viewMatrix.M01 = upwards.X
                viewMatrix.M11 = upwards.Y
                viewMatrix.M21 = upwards.Z
                
                viewMatrix.M02 = forwards.X
                viewMatrix.M12 = forwards.Y
                viewMatrix.M22 = forwards.Z
                
                #point1 = Rhino.Geometry.Point3d(-1,-1,-1)
                #point2 = Rhino.Geometry.Point3d(-1,-1,1)
                #point3 = Rhino.Geometry.Point3d(-1,1,-1)
                #point4 = Rhino.Geometry.Point3d(-1,1,1)
                #point5 = Rhino.Geometry.Point3d(1,-1,-1)
                #point6 = Rhino.Geometry.Point3d(1,-1,1)
                #point7 = Rhino.Geometry.Point3d(1,1,-1)
                #point8 = Rhino.Geometry.Point3d(1,1,1)
                
                bb = bb_object
                camLocNorm = camLoc.DistanceTo(Rhino.Geometry.Point3d(0,0,0))
                
                scale_factor = 1.25 * camLocNorm * math.tan(horizontal_halfangle)
                
                #a = viewMatrix * point1 * scale_factor
                #b = viewMatrix * point2 * scale_factor
                #c = viewMatrix * point3 * scale_factor
                #d = viewMatrix * point4 * scale_factor
                #e = viewMatrix * point5 * scale_factor
                #f = viewMatrix * point6 * scale_factor
                #g = viewMatrix * point7 * scale_factor
                #h = viewMatrix * point8 * scale_factor
                
                fieldToWorldSpace = viewMatrix * Rhino.Geometry.Transform.Scale(Rhino.Geometry.Point3d(0,0,0),scale_factor)
                
                worldToFieldSpace = clr.StrongBox[Rhino.Geometry.Transform]()
                fieldToWorldSpace.TryGetInverse(worldToFieldSpace)
                
                if cube_size == None:
                    cube_size = 16
                else:
                    cube_size = int(cube_size)
                    
                increment = 2/(cube_size - 1)
                grid_points = []
                grid_sds = []
                
                for i in range(cube_size):
                    for j in range(cube_size):
                        for k in range(cube_size):
                            point = Rhino.Geometry.Point3d(k*increment - 1, j*increment - 1, i*increment - 1)
                            world_pt = fieldToWorldSpace * point
                            grid_points.append((k*increment - 1, j*increment - 1, i*increment - 1))
                            dist = rs.Distance(geom.ClosestPoint(world_pt), world_pt)
                            sd = dist * -1 if geom.IsPointInside(world_pt, 0.000001, True) else dist
                            grid_sds.append(sd / scale_factor)
                
                surface_points = []
                surface_sds = []
                surface_pts_out = []
                if srf_pts_delta == None:
                    srf_pts_delta = 0.01
                else:
                    srf_pts_delta = float(srf_pts_delta)
                
                for v in verts:
                    s_pt = rg.Point3d(v.X, v.Y, v.Z)
                    s_pt.X += srf_pts_delta*(2*random.random() - 1)
                    s_pt.Y += srf_pts_delta*(2*random.random() - 1)
                    s_pt.Z += srf_pts_delta*(2*random.random() - 1)
                    surface_pts_out.append(s_pt)
                    field_surface_pt = worldToFieldSpace.Value * s_pt
                    surface_points.append((field_surface_pt.X, field_surface_pt.Y, field_surface_pt.Z))
                    dist = rs.Distance(geom.ClosestPoint(s_pt), s_pt)
                    sd = dist * -1 if geom.IsPointInside(s_pt, 0.000001, True) else dist
                    surface_sds.append(sd / scale_factor)
                
                random_points = []
                random_sds = []
                if num_random_pts == None:
                    num_random_pts = 1000
                else:
                    num_random_pts = int(num_random_pts)
                
                for i in range(num_random_pts):
                    field_pt = (random.random()*2 - 1, random.random()*2 - 1, random.random()*2 - 1)
                    random_points.append(field_pt)
                    world_pt = fieldToWorldSpace * Rhino.Geometry.Point3d(field_pt[0], field_pt[1], field_pt[2])
                    dist = rs.Distance(geom.ClosestPoint(world_pt), world_pt)
                    sd = dist * -1 if geom.IsPointInside(world_pt, 0.000001, True) else dist
                    random_sds.append(sd / scale_factor)
                
                with open(model_dir + "sample_points.csv", "wb") as csvfile:
                    csvwriter = csv.writer(csvfile,  delimiter=',')
                    csvwriter.writerow(["Grid Points", "_", "_", "_"])
                    for i in range(len(grid_points)):
                        csvwriter.writerow([grid_points[i][0], grid_points[i][1], grid_points[i][2], grid_sds[i]])
                    csvwriter.writerow(["Surface Points", "_", "_", "_"])
                    for i in range(len(surface_points)):
                        csvwriter.writerow([surface_points[i][0], surface_points[i][1], surface_points[i][2], surface_sds[i]])
                    csvwriter.writerow(["Random Points", "_", "_", "_"])
                    for i in range(len(random_points)):
                        csvwriter.writerow([random_points[i][0], random_points[i][1], random_points[i][2], random_sds[i]])
                        
                with open(model_dir + "camera_params.txt", "wb") as cfile:
                    cfile.write("Camera Position: (" + str(camLoc) + ")\n")
                    cfile.write("Camera Scale Factor: " + str(scale_factor) + "\n")
                    
                rs.Command("-ViewCaptureToFile " + chr(34) + model_dir + "sketch.png" + chr(34))
                
                # ==============================================
                
                #Clear Added Object
                rs.DeleteObjects(rs.ObjectsByLayer("CustomLayer"))
                
                sc.doc = ghdoc
                
                h += 1
            # print("Model Gen Success")
        # else:
            # print("Model Gen Failed")
        # print("Boolean Time: " + str(time.time() - start_t))
        # print("==============")
# print("Total Gen Time:" + str(time.time() - start_total))

sc.doc = old_doc
# ---------- end createboxes ----------
panel_2 = Panel(createboxes.out)
