# Grasshopper definition SDFDatasetModelGen.gh (Grasshopper 1.0.7)

panel = Panel("C:\Users\LabUser\Documents\Sketch-In-Context-Sp2024\SDFDatasets\")
createboxes = GhPythonScript(
    parent_dir=panel,
    num_models="15000",
    num_boxes="3",
    box_min_start="-2",
    box_min_end="0.25",
    box_max_start="-0.25",
    box_max_end="2",
    run_gen=Toggle(False))  # -> out, models, run_id
# ---------- createboxes: Python ----------
"""Creates Boxes.
    Inputs:
        x: The x script variable
        y: The y script variable
    Output:
        a: The a output variable"""

__author__ = "jlw387"
__version__ = "2022.03.14"

import random
import time
import sys
import os
import rhinoscriptsyntax as rs
import scriptcontext as sc
import Rhino.Geometry as rg
import Rhino

def gen_coord(start, end):
    return (float(end) - float(start))*random.random() + float(start)

#def populate(model, num, existing):
#    

old_doc = sc.doc
sc.doc = ghdoc

if parent_dir == None:
    parent_dir = "C:/Users/jlw387/Documents/Sketching in Context/Spring 2024/SketchToModel/SDFDatasets/"
elif parent_dir[-1] != "/" or parent_dir[-1] != "\\":
    parent_dir += "/"
if num_models == None:
    num_models = 30
if num_boxes == None:
    num_boxes = 3
if box_min_start == None:
    box_min_start = -10
if box_min_end == None:
    box_min_end = 0
if box_max_start == None:
    box_max_start = 0
if box_max_end == None:
    box_max_end = 10
if run_gen == None:
    run_gen = False

tol = 0.00001

# start_total = time.time()
if(run_gen):
    views = rs.ViewNames()
    modes=rs.ViewDisplayModes()
    viewtype="Pen"
    rs.EnableRedraw(False)
    if viewtype in modes:
        for view in views:
            rs.ViewDisplayMode(view, viewtype)
    
    run_id = "Gen_" + str(int(time.time()))
    
    models = []
    boxes = []
    box = []
    world_plane = rg.Plane(rg.Point3d(0,0,0), rg.Vector3d(0,0,1))
    
    os.mkdir(parent_dir + run_id + "/")
    h = 0
    while h < (int(num_models)):
        boxes = []
        object = []
        # start_t = time.time()
        for i in range(int(num_boxes)):
            temp_box = None
            while(temp_box == None):
                interval_x = rg.Interval(gen_coord(box_min_start, box_min_end), gen_coord(box_max_start, box_max_end))
                interval_y = rg.Interval(gen_coord(box_min_start, box_min_end), gen_coord(box_max_start, box_max_end))
                interval_z = rg.Interval(gen_coord(box_min_start, box_min_end), gen_coord(box_max_start, box_max_end))
                temp_box = rg.Brep.CreateFromBox(rg.Box(world_plane, interval_x, interval_y, interval_z))
            boxes.append(temp_box)
        # print("Box Creation: " + str(time.time() - start_t))
        # start_t = time.time()
        model = rg.Brep.CreateBooleanUnion([boxes[0]], tol)
        for i in range(int(num_boxes) - 1):
            temp_model = []
            if random.randint(0,1):
                for m in model:
                    temp_model.append(m)
                temp_model.append(boxes[i+1])
                model = rg.Brep.CreateBooleanUnion(temp_model, tol)
                # print("Union" + str(i+1))
            else:
                for m in model:
                    temp_res = rg.Brep.CreateBooleanDifference(m, boxes[i+1], tol)
                    for r in temp_res:
                        temp_model.append(r)
                if len(temp_model) > 0:
                    # print("Difference" + str(i+1))
                    model = rg.Brep.CreateBooleanUnion(temp_model, tol)
                # else:
                    # print("Difference" + str(i+1) + " (Failed)")
                    
        if model != None:
            if len(model) == 1:
                rs.MoveObject(model[0], -model[0].GetBoundingBox(True).Center)
                models.append(model[0])
                
                sc.doc = Rhino.RhinoDoc.ActiveDoc
                
                #Add Custom Layer
                if not rs.IsLayer("CustomLayer"):
                    rs.AddLayer("CustomLayer")
                
                #Clear Existing Objects
                rs.DeleteObjects(rs.ObjectsByLayer("CustomLayer"))
                
                #we add both the geometry and the attributes to the Rhino doc
                rhino_brep = sc.doc.Objects.Add(model[0])
                rs.ObjectLayer(rhino_brep, "CustomLayer")
                os.mkdir(parent_dir + run_id + "/Model_" + str(h) + "/")
                rs.Command("_-SaveAs _SaveSmall=_Yes " + chr(34) + parent_dir + run_id + "\\Model_" + str(h) + "\\Model.3dm" + chr(34), True)
                
                #Clear Added Object
                rs.DeleteObjects(rs.ObjectsByLayer("CustomLayer"))
                
                sc.doc = ghdoc
                
                h += 1
            # print("Model Gen Success")
        # else:
            # print("Model Gen Failed")
        # print("Boolean Time: " + str(time.time() - start_t))
        # print("==============")
# print("Total Gen Time:" + str(time.time() - start_total))

sc.doc = old_doc
# ---------- end createboxes ----------
panel_2 = Panel(createboxes.run_id)
