# Grasshopper definition SDFDatasetSketchSampleGen.gh (Grasshopper 1.0.7)

panel = Panel("C:\Users\LabUser\Documents\Sketch-In-Context-Sp2024\SDFDatasets\")
python = GhPythonScript(
    parent_dir=panel,
    run_id="Gen_1710532434_Test",
    start_index="14494",
    num_models="1",
    cube_size="16",
    srf_pts_delta="0.01",
    num_random_pts="2000",
    run_script=Toggle(False))  # -> out, geom, points, surface_pts_out, surface_sds
# ---------- python: Python ----------
__author__ = "jlw387"
__version__ = "2022.08.22"

import rhinoscriptsyntax as rs
import scriptcontext as sc
import Rhino.Geometry as rg
import System.Drawing as dw
import Rhino
import math
import random
import csv
import clr

if parent_dir == None:
    parent_dir = "C:/Users/jlw387/Documents/Sketching in Context/Spring 2024/SketchToModel/SDFDatasets/"
elif parent_dir[-1] != "/" or parent_dir[-1] != "\\":
    parent_dir += "/"
dataset_path = parent_dir + run_id + "\\"
start_index = int(start_index)
num_models = int(num_models)

old_doc = sc.doc
sc.doc = ghdoc

if run_script:
    rs.Command("_-Open " + chr(34) + dataset_path + "Model_0\\Model.3dm" + chr(34), True)
    
    for h in range(num_models):
        model_dir = dataset_path + "Model_" + str(start_index + h) + "\\"
        rs.Command("_-Open " + chr(34) + model_dir + "Model.3dm" + chr(34), True)
        current_view = sc.doc.Views.ActiveView.ActiveViewport
        current_view.Size = dw.Size(256,256)
        
        
        my_object = Rhino.RhinoDoc.ActiveDoc.Objects.FindByLayer("CustomLayer")[0]
        geom = my_object.BrepGeometry
        bb_object = my_object.BrepGeometry.GetBoundingBox(True)
        rs.MoveObject(my_object, -bb_object.Center)
        
        phi = math.radians(random.randint(30,150))
        theta = math.radians(random.randint(0,359))
        radius = 40
        
        camLoc = Rhino.Geometry.Point3d(radius*math.sin(phi)*math.cos(theta), radius*math.sin(phi)*math.sin(theta), radius*math.cos(phi))
                
        rs.ViewCameraTarget(camera=camLoc, target=rg.Point3d(0,0,0))
        bb_object = my_object.BrepGeometry.GetBoundingBox(True)
        rs.ZoomBoundingBox(bb_object)
        
        camLoc, _ = rs.ViewCameraTarget(target=rg.Point3d(0,0,0))
        
        d_hangle = clr.StrongBox[float]()
        v_hangle = clr.StrongBox[float]()
        h_hangle = clr.StrongBox[float]()
        
        current_view.GetCameraAngle(d_hangle, v_hangle, h_hangle)
        horizontal_halfangle = h_hangle.Value
        
        forwards = (rg.Point3d(0,0,0)-camLoc)
        forwards.Unitize()
        
        upwards_fixed = rs.ViewCameraUp()
        
        rightwards = rs.VectorCrossProduct(forwards, upwards_fixed)
        rightwards.Unitize()
        
        upwards = rs.VectorCrossProduct(rightwards, forwards)
        
        viewMatrix = Rhino.Geometry.Transform(1.0)
        
        viewMatrix.M00 = rightwards.X
        viewMatrix.M10 = rightwards.Y
        viewMatrix.M20 = rightwards.Z
        
        viewMatrix.M01 = upwards.X
        viewMatrix.M11 = upwards.Y
        viewMatrix.M21 = upwards.Z
        
        viewMatrix.M02 = forwards.X
        viewMatrix.M12 = forwards.Y
        viewMatrix.M22 = forwards.Z
        
        #point1 = Rhino.Geometry.Point3d(-1,-1,-1)
        #point2 = Rhino.Geometry.Point3d(-1,-1,1)
        #point3 = Rhino.Geometry.Point3d(-1,1,-1)
        #point4 = Rhino.Geometry.Point3d(-1,1,1)
        #point5 = Rhino.Geometry.Point3d(1,-1,-1)
        #point6 = Rhino.Geometry.Point3d(1,-1,1)
        #point7 = Rhino.Geometry.Point3d(1,1,-1)
        #point8 = Rhino.Geometry.Point3d(1,1,1)
        
        bb = bb_object
        camLocNorm = camLoc.DistanceTo(Rhino.Geometry.Point3d(0,0,0))
        
        scale_factor = 1.25 * camLocNorm * math.tan(horizontal_halfangle)
        
        #a = viewMatrix * point1 * scale_factor
        #b = viewMatrix * point2 * scale_factor
        #c = viewMatrix * point3 * scale_factor
        #d = viewMatrix * point4 * scale_factor
        #e = viewMatrix * point5 * scale_factor
        #f = viewMatrix * point6 * scale_factor
        #g = viewMatrix * point7 * scale_factor
        #h = viewMatrix * point8 * scale_factor
        
        fieldToWorldSpace = viewMatrix * Rhino.Geometry.Transform.Scale(Rhino.Geometry.Point3d(0,0,0),scale_factor)
        
        worldToFieldSpace = clr.StrongBox[Rhino.Geometry.Transform]()
        fieldToWorldSpace.TryGetInverse(worldToFieldSpace)
        
        points = []
        
        if cube_size == None:
            cube_size = 16
        else:
            cube_size = int(cube_size)
        increment = 2/(cube_size - 1)
        grid_points = []
        grid_sds = []
        
        for i in range(cube_size):
            for j in range(cube_size):
                for k in range(cube_size):
                    point = Rhino.Geometry.Point3d(k*increment - 1, j*increment - 1, i*increment - 1)
                    world_pt = fieldToWorldSpace * point
                    points.append(world_pt)
                    grid_points.append((k*increment - 1, j*increment - 1, i*increment - 1))
                    dist = rs.Distance(geom.ClosestPoint(world_pt), world_pt)
                    sd = dist * -1 if geom.IsPointInside(world_pt, 0.000001, True) else dist
                    grid_sds.append(sd / scale_factor)
        
        surface_points = []
        surface_sds = []
        surface_pts_out = []
        if srf_pts_delta == None:
            srf_pts_delta = 0.01
        else:
            srf_pts_delta = float(srf_pts_delta)
        
        with open(model_dir + "surface_points.csv", "r") as csvfile:
            csv_reader = csv.reader(csvfile)
            for row in csv_reader:
                s_pt = rg.Point3d(float(row[0]), float(row[1]), float(row[2]))
                s_pt.X += srf_pts_delta*(2*random.random() - 1)
                s_pt.Y += srf_pts_delta*(2*random.random() - 1)
                s_pt.Z += srf_pts_delta*(2*random.random() - 1)
                points.append(s_pt)
                surface_pts_out.append(s_pt)
                field_surface_pt = worldToFieldSpace.Value * s_pt
                surface_points.append((field_surface_pt.X, field_surface_pt.Y, field_surface_pt.Z))
                dist = rs.Distance(geom.ClosestPoint(s_pt), s_pt)
                sd = dist * -1 if geom.IsPointInside(s_pt, 0.000001, True) else dist
                surface_sds.append(sd / scale_factor)
        
        random_points = []
        random_sds = []
        if num_random_pts == None:
            num_random_pts = 1000
        else:
            num_random_pts = int(num_random_pts)
        
        for i in range(num_random_pts):
            field_pt = (random.random()*2 - 1, random.random()*2 - 1, random.random()*2 - 1)
            random_points.append(field_pt)
            world_pt = fieldToWorldSpace * Rhino.Geometry.Point3d(field_pt[0], field_pt[1], field_pt[2])
            points.append(world_pt)
            dist = rs.Distance(geom.ClosestPoint(world_pt), world_pt)
            sd = dist * -1 if geom.IsPointInside(world_pt, 0.000001, True) else dist
            random_sds.append(sd / scale_factor)
        
        with open(model_dir + "sample_points.csv", "wb") as csvfile:
            csvwriter = csv.writer(csvfile,  delimiter=',')
            csvwriter.writerow(["Grid Points", "_", "_", "_"])
            for i in range(len(grid_points)):
                csvwriter.writerow([grid_points[i][0], grid_points[i][1], grid_points[i][2], grid_sds[i]])
            csvwriter.writerow(["Surface Points", "_", "_", "_"])
            for i in range(len(surface_points)):
                csvwriter.writerow([surface_points[i][0], surface_points[i][1], surface_points[i][2], surface_sds[i]])
            csvwriter.writerow(["Random Points", "_", "_", "_"])
            for i in range(len(random_points)):
                csvwriter.writerow([random_points[i][0], random_points[i][1], random_points[i][2], random_sds[i]])
                
        with open(model_dir + "camera_params.txt", "wb") as cfile:
            cfile.write("Camera Position: (" + str(camLoc) + ")\n")
            cfile.write("Camera Scale Factor: " + str(scale_factor) + "\n")
            
        rs.Command("-ViewCaptureToFile " + chr(34) + model_dir + "sketch.png" + chr(34))
        
    
sc.doc = old_doc

print('Complete.')
# ---------- end python ----------
pt = Point(python.surface_pts_out)
geo = Geometry(python.geom)
pt_2 = Point(python.points)
panel_2 = Panel(pt_2)
panel_3 = Panel(python.out)
