# Grasshopper definition SDFDatasetSketchSampleViewer.gh (Grasshopper 1.0.7)

panel = Panel("C:\Users\LabUser\Documents\Sketch-In-Context-Sp2024\SDFDatasets\")
pointcheckviewer = GhPythonScript(parent_dir=panel, model_id="14494", run_id="Gen_1710532434_Test", run_script=Toggle(False))  # -> out, camLoc, scale_factor, points, sds
# ---------- pointcheckviewer: Python ----------
__author__ = "jlw387"
__version__ = "2022.08.21"

import rhinoscriptsyntax as rs
import scriptcontext as sc
import Rhino.Geometry as rg
import System.Drawing as dw
import Rhino

import csv
import clr
import math
import os

if parent_dir == None:
    parent_dir = "C:/Users/jlw387/Documents/Sketching in Context/Spring 2024/SketchToModel/SDFDatasets/"
elif parent_dir[-1] != "/" or parent_dir[-1] != "\\":
    parent_dir += "/"

dataset_path = parent_dir + run_id + "\\"
model_dir = dataset_path + "Model_" + str(model_id) + "\\"

print("Model Directory:", model_dir)

if bool(run_script):
    # Load Object
    rs.Command("_-Open " + chr(34) + model_dir + "Model.3dm" + chr(34), True)
    current_view = sc.doc.Views.ActiveView.ActiveViewport
    current_view.Size = dw.Size(256,256)
    
    my_object = Rhino.RhinoDoc.ActiveDoc.Objects.FindByLayer("CustomLayer")[0]
    geom = my_object.BrepGeometry
    bb_object = my_object.BrepGeometry.GetBoundingBox(True)
    rs.MoveObject(my_object, -bb_object.Center)
    
    
    # Load Camera
    with open(model_dir + "camera_params.txt") as cf:
        cam_info = cf.readlines()
        cam_pos_str_tup = cam_info[0].split(":")[1].strip().lstrip("(").rstrip(")").split(",")
        camLoc = rg.Point3d(float(cam_pos_str_tup[0]),\
                            float(cam_pos_str_tup[1]),\
                            float(cam_pos_str_tup[2]))
        rs.ViewCameraTarget(camera=camLoc, target=rg.Point3d(0,0,0))
    
        # Load Camera Transform
        d_hangle = clr.StrongBox[float]()
        v_hangle = clr.StrongBox[float]()
        h_hangle = clr.StrongBox[float]()
        
        current_view.GetCameraAngle(d_hangle, v_hangle, h_hangle)
        horizontal_halfangle = h_hangle.Value
        
        forwards = (rg.Point3d(0,0,0)-camLoc)
        forwards.Unitize()
        
        upwards_fixed = rs.ViewCameraUp()
        
        rightwards = rs.VectorCrossProduct(forwards, upwards_fixed)
        rightwards.Unitize()
        
        upwards = rs.VectorCrossProduct(rightwards, forwards)
        
        viewMatrix = Rhino.Geometry.Transform(1.0)
        
        viewMatrix.M00 = rightwards.X
        viewMatrix.M10 = rightwards.Y
        viewMatrix.M20 = rightwards.Z
        
        viewMatrix.M01 = upwards.X
        viewMatrix.M11 = upwards.Y
        viewMatrix.M21 = upwards.Z
        
        viewMatrix.M02 = forwards.X
        viewMatrix.M12 = forwards.Y
        viewMatrix.M22 = forwards.Z
        
        #point1 = Rhino.Geometry.Point3d(-1,-1,-1)
        #point2 = Rhino.Geometry.Point3d(-1,-1,1)
        #point3 = Rhino.Geometry.Point3d(-1,1,-1)
        #point4 = Rhino.Geometry.Point3d(-1,1,1)
        #point5 = Rhino.Geometry.Point3d(1,-1,-1)
        #point6 = Rhino.Geometry.Point3d(1,-1,1)
        #point7 = Rhino.Geometry.Point3d(1,1,-1)
        #point8 = Rhino.Geometry.Point3d(1,1,1)
        
        bb = bb_object
        camLocNorm = camLoc.DistanceTo(Rhino.Geometry.Point3d(0,0,0))
        
        scale_factor = 1.25 * camLocNorm * math.tan(horizontal_halfangle)
        saved_scale_factor = float(cam_info[1].split(":")[1])
        
        print("Computed Scale Factor:", scale_factor)
        print("Saved Scale Factor:", saved_scale_factor)
        
        #a = viewMatrix * point1 * scale_factor
        #b = viewMatrix * point2 * scale_factor
        #c = viewMatrix * point3 * scale_factor
        #d = viewMatrix * point4 * scale_factor
        #e = viewMatrix * point5 * scale_factor
        #f = viewMatrix * point6 * scale_factor
        #g = viewMatrix * point7 * scale_factor
        #h = viewMatrix * point8 * scale_factor
        
        fieldToWorldSpace = viewMatrix * Rhino.Geometry.Transform.Scale(Rhino.Geometry.Point3d(0,0,0),scale_factor)
        
        worldToFieldSpace = clr.StrongBox[Rhino.Geometry.Transform]()
        fieldToWorldSpace.TryGetInverse(worldToFieldSpace)
    
    points = []
    sds = []
    with open(model_dir + "sample_points.csv") as csvfile:
        csv_reader = csv.reader(csvfile)
        for row in csv_reader:
            is_number = False
            try:
                float(row[0])
                is_number = True
            except:
                pass
            
            if is_number:
                points.append(fieldToWorldSpace * rg.Point3d(float(row[0]), float(row[1]), float(row[2])))
                sds.append(float(row[3]))
# ---------- end pointcheckviewer ----------
panel_2 = Panel(pointcheckviewer.out)

# ----
# Signed Distance View
abs = Absolute(Value=pointcheckviewer.sds)
pt = Point(pointcheckviewer.points)
smaller = SmallerThan(FirstNumber=pointcheckviewer.sds, SecondNumber=0)  # -> SmallerThan, OrEqualTo
smaller_2 = SmallerThan(FirstNumber=abs, SecondNumber="0.03")  # -> SmallerThan, OrEqualTo
lng = ListLength(List=pt)
sift = SiftPattern(List=pt, SiftPattern=smaller.SmallerThan)  # -> Output0, Output1
sift_2 = SiftPattern(List=pointcheckviewer.sds, SiftPattern=smaller.SmallerThan)  # -> Output0, Output1
sift_3 = SiftPattern(List=pt, SiftPattern=smaller_2.OrEqualTo)  # -> Output0, Output1
panel_3 = Panel(lng)
sift_4 = SiftPattern(List=pointcheckviewer.sds, SiftPattern=smaller_2.OrEqualTo)  # -> Output0, Output1
gradient = Gradient(
    LowerLimit="1",
    UpperLimit="-1",
    Parameter=sift_2.Output1,
    stops=[0.396: RGB(234, 38, 0), 0.497: RGB(255, 160, 80), 0.5: RGB(224, 224, 224), 0.502: RGB(140, 160, 249), 0.6: RGB(0, 0, 192)])
gradient_2 = Gradient(
    LowerLimit="1",
    UpperLimit="-1",
    Parameter=pointcheckviewer.sds,
    stops=[0.396: RGB(234, 38, 0), 0.497: RGB(255, 160, 80), 0.5: RGB(224, 224, 224), 0.502: RGB(140, 160, 249), 0.6: RGB(0, 0, 192)])
gradient_3 = Gradient(
    LowerLimit="1",
    UpperLimit="-1",
    Parameter=sift_4.Output1,
    stops=[0.396: RGB(234, 38, 0), 0.497: RGB(255, 160, 80), 0.5: RGB(224, 224, 224), 0.502: RGB(140, 160, 249), 0.6: RGB(0, 0, 192)])
all_points = CustomPreview(Geometry=pt, Material=gradient_2)
inside_points = CustomPreview(Geometry=sift.Output1, Material=gradient)
near_surface_points = CustomPreview(Geometry=sift_3.Output1, Material=gradient_3)

# ----
# Camera Cone View
pl = PlaneNormal(Origin=pointcheckviewer.camLoc, ZAxis=unitize(pointcheckviewer.camLoc))
one_over_x = OneOverX(Value=pointcheckviewer.scale_factor)
addition = Addition(A=one_over_x, B="1")
pow = Power(A=pointcheckviewer.scale_factor, B=addition)
cone = Cone(Base=pl, Radius=pointcheckviewer.scale_factor, Length=pow)  # -> Cone, Tip
