# Grasshopper definition SDFDatasetSurfaceGen.gh (Grasshopper 1.0.7)

panel = Panel("C:\Users\LabUser\Documents\Sketch-In-Context-Sp2024\SDFDatasets\")
pointcheckviewer = GhPythonScript(parent_dir=panel, run_id="Gen_1710532434_Test", model_id="19")  # -> out, points
# ---------- pointcheckviewer: Python ----------
__author__ = "jlw387"
__version__ = "2022.08.21"

import rhinoscriptsyntax as rs
import Rhino.Geometry as rg
import os
import csv

if parent_dir == None:
    parent_dir = "C:/Users/jlw387/Documents/Sketching in Context/Spring 2024/SketchToModel/SDFDatasets/"
elif parent_dir[-1] != "/" or parent_dir[-1] != "\\":
    parent_dir += "/"
dataset_path = parent_dir + run_id + "\\"
points = []
try:
    with open(dataset_path + "Model_" + str(model_id) + "\\surface_points.csv") as csvfile:
        csv_reader = csv.reader(csvfile)
        for row in csv_reader:
            points.append(rg.Point3f(float(row[0]), float(row[1]), float(row[2])))
except Exception as e:
    print(e)
# ---------- end pointcheckviewer ----------
panel_2 = Panel(pointcheckviewer.out)
generateandsavepoints = GhPythonScript(
    parent_dir=panel,
    start_index="14494",
    num_models="1",
    srf_quads="4300",
    run_id="Gen_1710532434_Test",
    run_script=Toggle(False))  # -> out, dataset_path, mesh, verts, object, objects
# ---------- generateandsavepoints: Python ----------
__author__ = "jlw387"
__version__ = "2022.08.21"

import rhinoscriptsyntax as rs
import scriptcontext as sc
import Rhino.Geometry as rg
import Rhino
import os
import csv
import time

print("Finished Imports")

if parent_dir == None:
    parent_dir = "C:/Users/jlw387/Documents/Sketching in Context/Spring 2024/SketchToModel/SDFDatasets/"
elif parent_dir[-1] != "/" or parent_dir[-1] != "\\":
    parent_dir += "/"
dataset_path = parent_dir + run_id + "\\"
num_models = int(num_models)

qr_params = Rhino.Geometry.QuadRemeshParameters()
qr_params.AdaptiveQuadCount=True
qr_params.TargetQuadCount = int(srf_quads)
qr_params.AdaptiveSize = 50
qr_params.DetectHardEdges=True

verts = []

sc_old = sc.doc
sc.doc = Rhino.RhinoDoc.ActiveDoc

print("Starting Script")
print(dataset_path)

if run_script == bool(True):
    #rs.Command('_-Open ' + chr(34) + dataset_path  + "Model_0\\Model.3dm" + chr(34))
    
    #rs.Command('_-Open ' + chr(34) + dataset_path  + "Model_0\\Model.3dm" + chr(34))
    
    for i in range(num_models):
        model_dir = dataset_path + "Model_" + str(i + int(start_index)) + "\\"
        print("Ran open at " + str(i))
    
        rs.DocumentModified(False)
        # output = rs.Command('_-Open ' + chr(34) + model_dir + "Model.3dm" + chr(34))
    
        print(model_dir)
        # print(output)
        
#        objects = Rhino.RhinoDoc.ActiveDoc.Objects.GetObjectList(Rhino.DocObjects.ObjectEnumeratorSettings())
#        print("Start of Loop")
#        for ob in objects:
#            print(ob)
#        print("End of Loop")
#        print(len(Rhino.RhinoDoc.ActiveDoc.Objects.FindByLayer("CustomLayer")))
#        print(len(Rhino.RhinoDoc.ActiveDoc.Objects.FindByLayer("Default")))
        object = Rhino.RhinoDoc.ActiveDoc.Objects.FindByLayer("CustomLayer")[0]
        geom = object.BrepGeometry
        bb_object = object.BrepGeometry.GetBoundingBox(True)
        rs.MoveObject(object, -bb_object.Center)
        
        mesh = rg.Mesh.QuadRemeshBrep(object.BrepGeometry, qr_params)
        verts = mesh.Vertices
        
        with open(model_dir + "surface_points.csv", "wb") as csvfile:
            csvwriter = csv.writer(csvfile,  delimiter=',')
            for v in verts:
                csvwriter.writerow([v.X, v.Y, v.Z])
                
sc.doc = sc_old
print("Complete.")
# ---------- end generateandsavepoints ----------
pt = Point(pointcheckviewer.points)
geo = Geometry(generateandsavepoints.mesh)
pt_2 = Point(generateandsavepoints.verts)
geo_2 = Geometry(generateandsavepoints.objects)
