# Grasshopper definition SDFDatasetSurfaceViewer.gh (Grasshopper 1.0.7)

panel = Panel("C:\Users\LabUser\Documents\Sketch-In-Context-Sp2024\SDFDatasets\")
pointcheckviewer = GhPythonScript(parent_dir=panel, model_id="0", run_id="Gen_1710532434", run_script=Toggle(False))  # -> out, points
# ---------- pointcheckviewer: Python ----------
__author__ = "jlw387"
__version__ = "2022.08.21"

import rhinoscriptsyntax as rs
import scriptcontext as sc
import Rhino.Geometry as rg
import System.Drawing as dw
import Rhino

import csv
import clr
import math
import os

if parent_dir == None:
    parent_dir = "C:/Users/jlw387/Documents/Sketching in Context/Spring 2024/SketchToModel/SDFDatasets/"
elif parent_dir[-1] != "/" or parent_dir[-1] != "\\":
    parent_dir += "/"

dataset_path = parent_dir + run_id + "\\"
model_dir = dataset_path + "Model_" + str(model_id) + "\\"

print("Model Directory:", model_dir)

if bool(run_script):
    # Load Object
    rs.Command("_-Open " + chr(34) + model_dir + "Model.3dm" + chr(34), True)
        
    
    points = []
    with open(model_dir + "surface_points.csv") as csvfile:
        csv_reader = csv.reader(csvfile)
        for row in csv_reader:
            is_number = False
            try:
                float(row[0])
                is_number = True
            except:
                pass
            
            if is_number:
                points.append(rg.Point3d(float(row[0]), float(row[1]), float(row[2])))
# ---------- end pointcheckviewer ----------
panel_2 = Panel(pointcheckviewer.out)
pt = Point(pointcheckviewer.points)
