# Grasshopper definition ViewCaptureToFile.gh (Grasshopper 1.0.7)

panel = Panel("C:\Users\LabUser\Documents\Sketch-In-Context-Sp2024\SDFDatasets\")
python = GhPythonScript(
    parent_dir=panel,
    run_id="Gen_1710532434",
    start_index="0",
    num_models="15000",
    cube_size="16",
    srf_pts_delta="0.01",
    num_random_pts="2000",
    run_script=Toggle(True))  # -> out, geom, points, surface_pts_out, surface_sds
# ---------- python: Python ----------
__author__ = "jlw387"
__version__ = "2022.08.22"

import rhinoscriptsyntax as rs
import scriptcontext as sc
import Rhino.Geometry as rg
import System.Drawing as dw
import Rhino
import math
import random
import csv
import clr

if parent_dir == None:
    parent_dir = "C:/Users/jlw387/Documents/Sketching in Context/Spring 2024/SketchToModel/SDFDatasets/"
elif parent_dir[-1] != "/" or parent_dir[-1] != "\\":
    parent_dir += "/"
dataset_path = parent_dir + run_id + "\\"
start_index = int(start_index)
num_models = int(num_models)

old_doc = sc.doc
sc.doc = ghdoc

if run_script:
    rs.Command("_-Open " + chr(34) + dataset_path + "Model_0\\Model.3dm" + chr(34), True)
    
    for h in range(num_models):
        print(h)
        model_dir = dataset_path + "Model_" + str(start_index + h) + "\\"
        rs.Command("_-Open " + chr(34) + model_dir + "Model.3dm" + chr(34), True)
        current_view = sc.doc.Views.ActiveView.ActiveViewport
        current_view.Size = dw.Size(256,256)
        
        my_object = Rhino.RhinoDoc.ActiveDoc.Objects.FindByLayer("CustomLayer")[0]
        geom = my_object.BrepGeometry
        bb_object = my_object.BrepGeometry.GetBoundingBox(True)
        rs.MoveObject(my_object, -bb_object.Center)
        
        fieldToWorldSpace = viewMatrix * Rhino.Geometry.Transform.Scale(Rhino.Geometry.Point3d(0,0,0),scale_factor)
        
        worldToFieldSpace = clr.StrongBox[Rhino.Geometry.Transform]()
        fieldToWorldSpace.TryGetInverse(worldToFieldSpace)
       
                
        with open(model_dir + "camera_params.txt", "rb") as cfile:
            camLoc, scale_factor = cfile

        rs.ViewCameraTarget(camera=camLoc, target=rg.Point3d(0,0,0))
        bb_object = my_object.BrepGeometry.GetBoundingBox(True)
        rs.ZoomBoundingBox(bb_object)
        
        d_hangle = clr.StrongBox[float]()
        v_hangle = clr.StrongBox[float]()
        h_hangle = clr.StrongBox[float]()
        
        current_view.GetCameraAngle(d_hangle, v_hangle, h_hangle)
        horizontal_halfangle = h_hangle.Value
        
        forwards = (rg.Point3d(0,0,0)-camLoc)
        forwards.Unitize()
        
        upwards_fixed = rs.ViewCameraUp()
        
        rightwards = rs.VectorCrossProduct(forwards, upwards_fixed)
        rightwards.Unitize()
        
        upwards = rs.VectorCrossProduct(rightwards, forwards)
        
        viewMatrix = Rhino.Geometry.Transform(1.0)
        
        viewMatrix.M00 = rightwards.X
        viewMatrix.M10 = rightwards.Y
        viewMatrix.M20 = rightwards.Z
        
        viewMatrix.M01 = upwards.X
        viewMatrix.M11 = upwards.Y
        viewMatrix.M21 = upwards.Z
        
        viewMatrix.M02 = forwards.X
        viewMatrix.M12 = forwards.Y
        viewMatrix.M22 = forwards.Z
        
        bb = bb_object
        camLocNorm = camLoc.DistanceTo(Rhino.Geometry.Point3d(0,0,0))
        
        scale_factor = 1.25 * camLocNorm * math.tan(horizontal_halfangle)
        
        camLoc, _ = rs.ViewCameraTarget(target=rg.Point3d(0,0,0))
            
        rs.Command("-ViewCaptureToFile " + chr(34) + model_dir + "sketch.png" + chr(34))
        
    
sc.doc = old_doc

print('Complete.')
# ---------- end python ----------
pt = Point(python.surface_pts_out)
geo = Geometry(python.geom)
pt_2 = Point(python.points)
panel_2 = Panel(pt_2)
panel_3 = Panel(python.out)
